# Grasshopper definition assignment2.gh (Grasshopper 1.0.7)

number_slider = Slider(3.8, range=0..100)
number_slider_2 = Slider(25, range=0..100)
number_slider_3 = Slider(10, range=0..100)
number_slider_4 = Slider(3.8, range=0..100)
number_slider_5 = Slider(25, range=0..100)
number_slider_6 = Slider(10, range=0..100)
number_slider_7 = Slider(3.8, range=0..100)
number_slider_8 = Slider(25, range=0..100)
number_slider_9 = Slider(10, range=0..100)
rectangle = Rectangle(Plane=PlaneXY(0, 0, 0), XSize=number_slider, YSize=number_slider_3, Radius=0)  # -> Rectangle, Length
rectangle_2 = Rectangle(Plane=PlaneXY(0, 0, 0), XSize=number_slider_4, YSize=number_slider_6, Radius=0)  # -> Rectangle, Length
subtraction = Subtraction(A=number_slider_2, B=number_slider_3)
division = Division(A=number_slider, B=-2)
subtraction_2 = Subtraction(A=number_slider_5, B=number_slider_6)
rectangle_3 = Rectangle(Plane=PlaneXY(0, 0, 0), XSize=number_slider_7, YSize=number_slider_9, Radius=0)  # -> Rectangle, Length
division_2 = Division(A=number_slider_4, B=-2)
vector_xyz = VectorXYZ(XComponent=division, YComponent=subtraction, ZComponent=0)  # -> Vector, Length
subtraction_3 = Subtraction(A=number_slider_8, B=number_slider_9)
division_3 = Division(A=number_slider_7, B=-2)
vector_xyz_2 = VectorXYZ(XComponent=division_2, YComponent=subtraction_2, ZComponent=0)  # -> Vector, Length
move = Move(Geometry=rectangle.Rectangle, Motion=vector_xyz.Vector)  # -> Geometry, Transform
vector_xyz_3 = VectorXYZ(XComponent=division_3, YComponent=subtraction_3, ZComponent=0)  # -> Vector, Length
polygon = Polygon(Plane=PlaneXY(0, 0, 0), Radius=number_slider_5, Segments=8, FilletRadius=0)  # -> Polygon, Length
move_2 = Move(Geometry=rectangle_2.Rectangle, Motion=vector_xyz_2.Vector)  # -> Geometry, Transform
polygon_2 = Polygon(Plane=PlaneXY(0, 0, 0), Radius=number_slider_8, Segments=10, FilletRadius=0)  # -> Polygon, Length
area = Area(Geometry=polygon.Polygon)  # -> Area, Centroid
move_3 = Move(Geometry=rectangle_3.Rectangle, Motion=vector_xyz_3.Vector)  # -> Geometry, Transform
radians = Radians(Degrees=Slider(68, range=0..360))
polygon_3 = Polygon(Plane=PlaneXY(0, 0, 0), Radius=number_slider_2, Segments=6, FilletRadius=0)  # -> Polygon, Length
polar_array = PolarArray(Geometry=move.Geometry, Plane=PlaneXY(0, 0, 0), Count=Slider(3, range=0..10), Angle=6.283185307)  # -> Geometry, Transform
area_2 = Area(Geometry=polygon_2.Polygon)  # -> Area, Centroid
radians_2 = Radians(Degrees=Slider(72, range=0..360))
polar_array_2 = PolarArray(Geometry=move_2.Geometry, Plane=PlaneXY(0, 0, 0), Count=Slider(4, range=0..10), Angle=6.283185307)  # -> Geometry, Transform
rotate = Rotate(Geometry=polygon.Polygon, Angle=radians, Plane=area.Centroid)  # -> Geometry, Transform
polar_array_3 = PolarArray(Geometry=move_3.Geometry, Plane=PlaneXY(0, 0, 0), Count=Slider(5, range=0..10), Angle=6.283185307)  # -> Geometry, Transform
rotate_2 = Rotate(Geometry=polygon_2.Polygon, Angle=radians_2, Plane=area_2.Centroid)  # -> Geometry, Transform
trim_with_regions = TrimWithRegions(Curve=polygon_3.Polygon, Regions=polar_array.Geometry)  # -> Inside, flatten(Outside)
trim_with_regions_2 = TrimWithRegions(Curve=polar_array.Geometry, Regions=polygon_3.Polygon)  # -> flatten(Inside), Outside
trim_with_regions_3 = TrimWithRegions(Curve=rotate.Geometry, Regions=polar_array_2.Geometry)  # -> Inside, flatten(Outside)
trim_with_regions_4 = TrimWithRegions(Curve=polar_array_2.Geometry, Regions=rotate.Geometry)  # -> flatten(Inside), Outside
trim_with_regions_5 = TrimWithRegions(Curve=rotate_2.Geometry, Regions=polar_array_3.Geometry)  # -> Inside, flatten(Outside)
trim_with_regions_6 = TrimWithRegions(Curve=polar_array_3.Geometry, Regions=rotate_2.Geometry)  # -> flatten(Inside), Outside
join_curves = JoinCurves(Curves=[trim_with_regions.Outside, trim_with_regions_2.Inside], Preserve=False)
join_curves_2 = JoinCurves(Curves=[trim_with_regions_3.Outside, trim_with_regions_4.Inside], Preserve=False)
join_curves_3 = JoinCurves(Curves=[trim_with_regions_5.Outside, trim_with_regions_6.Inside], Preserve=False)
