# Grasshopper definition assignment3.gh (Grasshopper 1.0.7)

number_slider = Slider(20, range=0..25)
number_slider_2 = Slider(30, range=0..35)
number_slider_3 = Slider(15, range=0..35)
rectangle = Rectangle(Plane=PlaneXY(0, 0, 0), XSize=number_slider, YSize=number_slider, Radius=0)  # -> Rectangle, Length
circle = Circle(Plane=PlaneXY(0, 0, 0), Radius=number_slider_3)
vector_xyz = VectorXYZ(XComponent=0, YComponent=0, ZComponent=number_slider)  # -> Vector, Length
vector_xyz_2 = VectorXYZ(XComponent=0, YComponent=0, ZComponent=number_slider_3)  # -> Vector, Length
extrude = Extrude(Base=rectangle.Rectangle, Direction=vector_xyz.Vector)
extrude_2 = Extrude(Base=circle, Direction=vector_xyz_2.Vector)
