# Grasshopper definition lampbackup.gh (Grasshopper 1.0.7)

number_slider = Slider(2.5, range=0..100)
number_slider_2 = Slider(30, range=0..100)
number_slider_3 = Slider(8, range=0..100)
rectangle = Rectangle(Plane=PlaneXY(0, 0, 0), XSize=number_slider, YSize=number_slider_3, Radius=0)  # -> Rectangle, Length
subtraction = Subtraction(A=number_slider_2, B=number_slider_3)
division = Division(A=number_slider, B=-2)
vector_xyz = VectorXYZ(XComponent=division, YComponent=subtraction, ZComponent=0)  # -> Vector, Length
move = Move(Geometry=rectangle.Rectangle, Motion=vector_xyz.Vector)  # -> Geometry, Transform
circle = Circle(Plane=PlaneXY(0, 0, 0), Radius=Slider(18.5, range=0..100))
circle_2 = Circle(Plane=PlaneXY(0, 0, 0), Radius=number_slider_2)
polar_array = PolarArray(Geometry=move.Geometry, Plane=PlaneXY(0, 0, 0), Count=Slider(6, range=0..10), Angle=6.283185307)  # -> Geometry, Transform
trim_with_regions = TrimWithRegions(Curve=circle_2, Regions=polar_array.Geometry)  # -> Inside, flatten(Outside)
trim_with_regions_2 = TrimWithRegions(Curve=polar_array.Geometry, Regions=circle_2)  # -> flatten(Inside), Outside
join_curves = JoinCurves(Curves=[trim_with_regions.Outside, trim_with_regions_2.Inside], Preserve=False)
