# Grasshopper definition lamphex.gh (Grasshopper 1.0.7)

number_slider = Slider(6, range=0..10)
number_slider_2 = Slider(6, range=0..10)
number_slider_3 = Slider(6, range=0..10)
rectangle = Rectangle(Plane=PlaneXY(0, 0, 0), XSize=Slider(43, range=0..200), YSize=Slider(20, range=0..200), Radius=0)  # -> Rectangle, Length
polygon = Polygon(Plane=PlaneXY(0, 0, 0), Radius=Slider(200, range=0..200), Segments=number_slider, FilletRadius=0)  # -> Polygon, Length
polygon_2 = Polygon(Plane=PlaneXY(0, 0, 0), Radius=Slider(185, range=0..200), Segments=number_slider, FilletRadius=0)  # -> Polygon, Length
polygon_3 = Polygon(Plane=PlaneXY(0, 0, 0), Radius=Slider(160, range=0..200), Segments=number_slider_2, FilletRadius=0)  # -> Polygon, Length
polygon_4 = Polygon(Plane=PlaneXY(0, 0, 0), Radius=Slider(145, range=0..200), Segments=number_slider_2, FilletRadius=0)  # -> Polygon, Length
polygon_5 = Polygon(Plane=PlaneXY(0, 0, 0), Radius=Slider(180, range=0..200), Segments=number_slider_3, FilletRadius=0)  # -> Polygon, Length
polygon_6 = Polygon(Plane=PlaneXY(0, 0, 0), Radius=Slider(165, range=0..200), Segments=number_slider_3, FilletRadius=0)  # -> Polygon, Length
trim_with_regions = TrimWithRegions(Curve=polygon.Polygon, Regions=polygon_2.Polygon)  # -> Inside, Outside
trim_with_regions_2 = TrimWithRegions(Curve=polygon_3.Polygon, Regions=polygon_4.Polygon)  # -> Inside, Outside
trim_with_regions_3 = TrimWithRegions(Curve=polygon_5.Polygon, Regions=polygon_6.Polygon)  # -> Inside, Outside
