# Grasshopper definition pokeballstand.gh (Grasshopper 1.0.7)

number_slider = Slider(5, range=0..100)
cylinder = Cylinder(Base=PlaneXY(0, 0, 0), Radius=Slider(6.5, range=0..100), Length=Slider(15, range=0..100))
cylinder_2 = Cylinder(Base=PlaneXY(0, 0, 0), Radius=Slider(20, range=0..100), Length=number_slider)
cap_holes = CapHoles(Brep=cylinder_2)
unit_z = UnitZ(Factor=number_slider)
move = Move(Geometry=cylinder, Motion=unit_z)  # -> Geometry, Transform
cap_holes_2 = CapHoles(Brep=move.Geometry)
solid_union = SolidUnion(Breps=[cap_holes_2, cap_holes])
